# Grasshopper definition main.gh (Grasshopper 1.0.8)

path = FilePath("/Users/sanghoon/Documents/GitHub/BuildableRegionGenrator/data/Parcels.shp")
list = ValueList({"1168010800100880001", "1168010800100880007", "1168010800100880008", "1168010800100880009", "1168010800100880011"}, selected="1168010800100880011")
py3 = Python3Script(script=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, shp_dir=path)  # -> out; unedited script template
panel = Panel(py3)
py3_2 = Python3Script(script=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, shp_path=path, pnu=list)  # -> out, target_lot_region, other_lot_regions; inputs pnu: String; unedited script template
py3_3 = Python3Script(script=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, target_lot_region=py3_2.target_lot_region, other_lot_regions=py3_2.other_lot_regions)  # -> out, northsky_base_segments, northsky_buildable_boundary; inputs target_lot_region: Curve, other_lot_regions: list of Curve; unedited script template
panel_2 = Panel(py3_2.out)
boundary = BoundarySurfaces(Edges=py3_3.northsky_buildable_boundary)
py3_4 = Python3Script()  # -> a, b, c, d
# ---------- py3_4: Python ----------
import scriptcontext as sc

a = sc.sticky["northsky_target_segs"]
b = sc.sticky["northsky_result_bases"]
c = sc.sticky["northsky_filtered_segs"]
d = sc.sticky["northsky_crvs_check"]

a,b,c,d = sc.sticky["northsky_debug_region"]

print(d)
for aa in d:
    print(aa)
    print(type(aa))
# ---------- end py3_4 ----------
pipe = Pipe(Curve=py3_3.northsky_base_segments, Radius=1, Caps=0, FitRail=False)  # disabled
preview = CustomPreview(
    Geometry=py3_4.d,
    Material={diffuse=RGB(228, 178, 227), emission=RGB(68, 53, 68), shine=0.5, specular=RGB(255, 254, 255), transparency=0})
boundary_2 = BoundarySurfaces(Edges=py3_4.d)
panel_3 = Panel(py3_3.out)
